# Grasshopper definition Finding path.gh (Grasshopper 1.0.7)

python = GhPythonScript(x=Slider(14, range=0..100), y=Slider(23, range=0..100))  # -> out, grid, paths; inputs x: Int32, y: Int32
# ---------- python: Python ----------
# 01:59:55 in AI 7-2.m4a

import ghpythonlib.components as gh
import random as r

seed = r.seed(y)

grid = []
# create a grid of pts in 3d(x,y,z)

for i in range(10):
    for j in range(10):
        for k in range(10):
            grid.append(gh.ConstructPoint(i,j,k))

ground = filter(lambda x: x[2]==0,grid)

# 02:05:25
class Agent:
    #constructor
    def __init__(self):
        self.route = [r.choice(ground)]
        self.pts = grid[:]
        self.pts.remove(self.route[0])
        self.update()

    def update(self):
        while self.route[-1][2]<9: # white true untill the route[2] is 9 
            pt = self.nextStep(self.route[-1])
            self.route.append(pt)
        
        self.path = gh.PolyLine(self.route, False)
    
    def nextStep(self, currentPt):
        possible_move = filter(lambda x: abs(x[0]-currentPt[0]) +
        abs(x[1]-currentPt[1]) + x[2]-currentPt[2] == 1 and x[2]-currentPt[2]>=0,self.pts)
        
        nextPt = r.choice(possible_move)
        self.pts.remove(nextPt)
        return nextPt


agents = [Agent() for _ in range(x)]
paths = [i.path for i in agents]
# ---------- end python ----------
number_slider = Slider(0.3, range=0..1)

# ----
# 3D Grid Agent
# With Comments
number_slider_2 = Slider(16, range=0..100)
python_2 = GhPythonScript(x=number_slider_2, y=Slider(23, range=0..100))  # -> out, paths; inputs x: Int32, y: Int32
# ---------- python_2: Python ----------
# 01:59:55 in AI 7-2.m4a file

import ghpythonlib.components as gh
import random as r

seed = r.seed(y)

# 02:01:02 in AI 7-2.m4a  create 3D grid points
grid = []

for i in range(10):
    for j in range(10):
        for k in range(10):
            grid.append(gh.ConstructPoint(i,j,k))

# 02:07:02 in AI 7-2.m4a
ground = filter(lambda x:x[2]==0,grid)  # separate the groundFloor from other # possible start points 
# x[2]==0

class Agent:
    #construtor
    def __init__(self):
        self.route = [r.choice(ground)]  # choosing a pt from fst_flr pts
        self.pts = grid[:]
        self.pts.remove(self.route[0])
        self.update()

# 02:14:52 in AI 72-2.m4a file
# 02:17:35 in AI 72-2.m4a file 

    def update(self): # while the condition is The route will continue
        while self.route[-1][2]<9: # while true  until the route is 9 (range(0,9))  # 02:18:03 
            pt = self.nextStep(self.route[-1])
            self.route.append(pt) 
        
        self.path = gh.PolyLine(self.route, False)
    # 02:20:57
    def nextStep(self, currentPt):  # give the current pt and return next point
        possible_move = filter(lambda x: abs(x[0]-currentPt[0]) +
        abs(x[1]-currentPt[1]) + x[2]-currentPt[2] == 1 and x[2]-currentPt[2]>=0,self.pts)   # delta x + delta y + Z difference == 1 and must be positive or equal
        
        nextPt = r.choice(possible_move) 
        self.pts.remove(nextPt)  # shulden't select itself
        return nextPt

#pt is Chance to choose between the possible and the last point
agents = [Agent() for _ in range(x)]
paths = [i.path for i in agents]

# homework at 02:59:10 in AI 7-2.m4a
# ---------- end python_2 ----------

ghpython_script = GhPythonScript()  # -> out, grid
# ---------- ghpython_script: Python ----------
import rhinoscriptsyntax as rs
import ghpythonlib.components as gh
import random

grid = []

for i in range(10):
    for j in range(10):
        for k in range(10):
            p = rs.AddPoint(i, j, k)
            grid.append(p)
# ---------- end ghpython_script ----------
pt = Point(python.grid)
crv = Curve(python.paths)

fillet = Fillet(Curve=crv, Radius=number_slider)
pipe = Pipe(Curve=fillet, Radius=Slider(0.1, range=0..0.1), Caps=0)
create_material = CreateMaterial(
    Diffuse=ColourSwatch(SwatchColor=RGB(86, 135, 78)),
    Specular=RGB(255, 255, 255),
    Emission=RGB(0, 0, 0),
    Transparency=0,
    Shine=0)
custom_preview = CustomPreview(Geometry=pipe, Material=create_material)

custom_preview_2 = CustomPreview(Geometry=ghpython_script.grid, Material=ColourSwatch(SwatchColor=RGB(143, 143, 143)))
join_curves = JoinCurves(Curves=python_2.paths, Preserve=False)

fillet_2 = Fillet(Curve=join_curves, Radius=number_slider)
pipe_2 = Pipe(Curve=fillet_2, Radius=Slider(0.1, range=0..0.1), Caps=0)
create_material_2 = CreateMaterial(
    Diffuse=ColourSwatch(SwatchColor=RGB(133, 194, 124)),
    Specular=RGB(255, 255, 255),
    Emission=RGB(0, 0, 0),
    Transparency=0,
    Shine=0)
custom_preview_3 = CustomPreview(Geometry=pipe_2, Material=create_material_2)

ghpython_script_2 = GhPythonScript(x=Slider(22, range=0..100), y=Slider(32, range=0..100))  # -> out, a; inputs x: Int32, y: Int32
# ---------- ghpython_script_2: Python ----------
__author__ = "Omid"
__version__ = "2022.04.05"

import rhinoscriptsyntax as rs

import ghpythonlib.components as gh
import random as r

grid = []

for i in range(10):
    for j in range(10):
        for k in range(10):
            grid.append(gh.ConstructPoint(i,j,k))


ground = filter(lambda x:x[2] ==0, grid)
# ---------- end ghpython_script_2 ----------
